# Grasshopper definition brise_parametrico_2021b.gh (Grasshopper 1.0.7)

curve = Curve(<curve referenced from the Rhino model>)

# ---- group: Eixos dos montantes
unit_z = UnitZ(Factor=Slider(12.53, range=1..20))
divide_curve = DivideCurve(Curve=curve, Count=Slider(18, range=1..20), Kinks=False)  # -> Points, Tangents, Parameters
move = Move(Geometry=divide_curve.Points, Motion=unit_z)  # -> Geometry, Transform
line = Line(StartPoint=divide_curve.Points, EndPoint=move.Geometry)

# ---- group: montantes
construct_plane = ConstructPlane(Origin=divide_curve.Points, XAxis=divide_curve.Tangents, YAxis=Vector(0, 1, 0))
rectangular_surface_on_plane = RectangularSurfaceOnPlane(plane=construct_plane, angle="0", x_dimension=Slider(0.13, range=0..10), y_dimension=Slider(0.9, range=0..10))
extrude_along = ExtrudeAlong(Base=rectangular_surface_on_plane, Curve=line)

# ---- group: Editando listas dos eixos dos montantes
closed = Closed(Curve=curve)  # -> Closed, Periodic
shift_list = ShiftList(List=line, Shift=1, Wrap=closed.Closed)
shortest_list = ShortestList(ListListA=line, ListListB=shift_list, TrimMode=2)  # -> ListListA, ListListB

# ----
panel = Panel(closed.Closed)
number_slider = Slider(21, range=0..100)

# ---- group: Start Points
divide_curve_2 = DivideCurve(Curve=shortest_list.ListListA, Count=number_slider, Kinks=False)  # -> Points, Tangents, Parameters

# ---- group: End Points
divide_curve_3 = DivideCurve(Curve=shortest_list.ListListB, Count=number_slider, Kinks=False)  # -> Points, Tangents, Parameters

# ---- group: Eixos das Aletas
line_2 = Line(StartPoint=divide_curve_2.Points, EndPoint=divide_curve_3.Points)

# ----
panel_2 = Panel(line_2)

# ---- group: Aletas
construct_plane_2 = ConstructPlane(Origin=divide_curve_2.Points, XAxis=line_2, YAxis=unit_z)
deconstruct_plane = DeconstructPlane(Plane=construct_plane_2)  # -> Origin, XAxis, YAxis, ZAxis
construct_plane_3 = ConstructPlane(Origin=deconstruct_plane.Origin, XAxis=deconstruct_plane.ZAxis, YAxis=deconstruct_plane.YAxis)
rectangular_surface_on_plane_2 = RectangularSurfaceOnPlane(
    plane=construct_plane_3,
    angle=Slider(50.81, range=0..360),
    x_dimension=Slider(0.4, range=0..1),
    y_dimension=Slider(0.06, range=0..1))

# ----
extrude_along_2 = ExtrudeAlong(Base=rectangular_surface_on_plane_2, Curve=line_2)

# ==== cluster RectangularSurfaceOnPlane
y_dimension = ClusterInput()  # y dimension of the surface
x_dimension = ClusterInput()  # x dimension of the surface
angle = ClusterInput()  # Angle in degrees to rotate the plane
plane = ClusterInput()  # plane to construct the surface
division = Division(A=x_dimension, B="2")
division_2 = Division(A=y_dimension, B="2")
rotate_plane = RotatePlane(Plane=plane, Angle=degrees(angle))
negative = Negative(Value=division)
negative_2 = Negative(Value=division_2)
construct_domain = ConstructDomain(DomainStart=negative_2, DomainEnd=division_2)
construct_domain_2 = ConstructDomain(DomainStart=negative, DomainEnd=division)
rectangle = Rectangle(Plane=rotate_plane, XSize=construct_domain_2, YSize=construct_domain, Radius=0)  # -> Rectangle, Length
boundary_surfaces = BoundarySurfaces(Edges=rectangle.Rectangle)
surfaces = ClusterOutput(boundary_surfaces)
