# Grasshopper definition list_handling.gh (Grasshopper 1.0.7)

curve = Curve()
panel = Panel("""a
b
c
d
e
f""")
divide_curve = DivideCurve(Curve=curve, Count=10, Kinks=False)  # -> Points, Tangents, Parameters
construct_point = ConstructPoint(XCoordinate=0, YCoordinate=0, ZCoordinate=0)
series = Series(Start=Slider(0, range=-10..10), Step=Slider(0.5, range=-10..10), Count=Slider(7, range=1..20))
weave = Weave(Pattern=[0, 1], NullGaps=False)
tree_branch = TreeBranch(MaintainPaths=True)
flatten_tree = FlattenTree(Path="{0}")
split_list = SplitList()  # -> ListA, ListB
partition_list = PartitionList(Size=[3, 2])
replace_items = ReplaceItems(Wrap=False)
cull_index = CullIndex(Wrap=True)
reverse_list = ReverseList()
suirify = Suirify()
list_item = ListItem(Index=0, Wrap=True)
shift = ShiftList(Shift=1, Wrap=True)
shortest_list = ShortestList(TrimMode=2)  # -> ListListA, ListListB
longest_list = LongestList(PaddingMode=2)  # -> ListListA, ListListB
cross_reference = CrossReference(CrossMode=1)  # -> ListListA, ListListB
concatenate = Concatenate()
line = Line()
